# Grasshopper definition assignment-01.gh (Grasshopper 1.0.8)

r = Slider(4, range=1..10)
x = Slider(4, range=1..10)

# ---- group: Example: Build a Parametric Cone
pt = Point(Point(-4.486961683, 4.807214, 0))
cone = Python3Script(pt=pt, h=Slider(8, range=1..10), r=Slider(3, range=1..10))  # -> out, my_cone; inputs pt: Point3d
# ---------- cone: Python ----------
# import function
from cdf import create_cone

# call function
my_cone = create_cone(base_point=pt, height=h, radius=r)

print(r)
# ---------- end cone ----------

# ---- group: Auto-reloads cdf module on VScode changes
# Setting path for Src AutoReloader: 1. Right click on Path
# 2. Choose "Select a directory"
# 3. Locate the ..\cdf1_teaching\src folder in your computer
# Assignment-01: Bauhaus
path = FilePath("/Users/tillmirkes/workspace/cdf1_teaching/src/")
autoreloader = Python3Script(src_path=path)  # -> out; inputs src_path: String
# ---------- autoreloader: Python ----------
#! python3
import sys, os, time
import scriptcontext as sc
import Rhino, System
from System.IO import FileSystemWatcher, NotifyFilters

VERSION = 1  
pkg = "cdf"

if not src_path:
    raise Exception("Connect a folder to src_path.")
path = os.path.normpath(src_path)
watch_dir = os.path.join(path, pkg)
if not os.path.isdir(watch_dir):
    raise Exception("No '{}' folder found in:\n{}".format(pkg, path))

def unload():
    for name in list(sys.modules):
        if name == pkg or name.startswith(pkg + "."):
            del sys.modules[name]

# Put this folder first in Python's search list
if path in sys.path:
    sys.path.remove(path)
sys.path.insert(0, path)

key = "cdf_watcher_" + str(ghenv.Component.InstanceGuid)
time_key = key + "_time"
version_key = key + "_version"

def stamp():
    sc.sticky[time_key] = time.strftime("%Y-%m-%d %H:%M:%S")

# Replace the old watcher if the folder changed or the script was updated
old = sc.sticky.get(key)
if old is not None and (os.path.normpath(old.Path) != watch_dir
                        or sc.sticky.get(version_key) != VERSION):
    old.Dispose()
    del sc.sticky[key]
    unload()

if key not in sc.sticky:
    comp = ghenv.Component
    last = [0.0]

    def reload_and_rerun():
        unload()
        stamp()
        doc = comp.OnPingDocument()
        if doc is None:            # reloader was deleted or the file closed
            return
        for obj in doc.Objects:
            if "Python" in obj.GetType().Name:
                obj.ExpireSolution(False)   # mark as out of date
        doc.NewSolution(False)              # recompute once

    def on_change(sender, e):
        if not e.FullPath.endswith(".py") or "__pycache__" in e.FullPath:
            return
        if time.time() - last[0] < 0.5:     # ignore the second event of a double save
            return
        last[0] = time.time()
        Rhino.RhinoApp.InvokeOnUiThread(System.Action(reload_and_rerun))

    w = FileSystemWatcher(watch_dir, "*.py")
    w.IncludeSubdirectories = True
    w.NotifyFilter = NotifyFilters.LastWrite
    w.Changed += on_change
    w.EnableRaisingEvents = True
    sc.sticky[key] = w
    sc.sticky[version_key] = VERSION
    stamp()                                  # time the watcher started

msg = "Last reloaded: {}\nWatching: {}".format(sc.sticky.get(time_key, "unknown"), watch_dir)
print(msg)
out = msg
# ---------- end autoreloader ----------
panel = Panel(autoreloader)

# ----
pt_2 = Point(Point(0.7029613237, 0.08451514811, 0))
y = Slider(4, range=1..10)

# ---- group: Example: Build a Parametric Cone
w = Slider(1, range=1..10)
pyramid = Python3Script(pt=pt_2, h=Slider(1, range=1..10), w=w)  # -> out, my_pyramid; inputs pt: Point3d
# ---------- pyramid: Python ----------
# import function
from cdf import create_pyramid

# call function
my_pyramid = create_pyramid(base_point=pt, height=h, base_width=w)
# ---------- end pyramid ----------

# ----
z = Slider(4, range=1..10)

# ---- group: TODO: Build a Parametric Sphere
sphere = Python3Script(r=r)  # -> out, my_sphere
# ---------- sphere: Python ----------
# import function
from cdf import create_sphere

# call function
my_sphere = create_sphere(center_point=pt, radius=r)
# ---------- end sphere ----------

# ---- group: TODO: Make Transformations
transformation = Python3Script(my_sphere=sphere.my_sphere, distance=Slider(4, range=1..10), count=Slider(5, range=1..10))  # -> out, my_spheres; inputs my_sphere: Brep
# ---------- transformation: Python ----------
from cdf import copy_brep_along_z

my_spheres = copy_brep_along_z(my_sphere, distance, count)
# ---------- end transformation ----------

# ---- group: TODO: Make a Boolean Difference
boolean = Python3Script(my_cone=cone.my_cone, my_sphere=sphere.my_sphere)  # -> out, result_geometry; inputs my_cone: Brep, my_sphere: Brep
# ---------- boolean: Python ----------
from cdf import boolean_difference

result_geometry = boolean_difference(my_cone, my_sphere)
# ---------- end boolean ----------

# ----
box = Python3Script(x=x, y=y, z=z)  # -> out, my_box
# ---------- box: Python ----------
# import function
from cdf import create_box

# call function
my_box = create_box(origin=pt, length=x, width=y, height=z)
# ---------- end box ----------
transformation_2 = Python3Script(my_sphere=box.my_box, distance=Slider(4, range=1..10), count=Slider(2, range=1..10))  # -> out, my_spheres; inputs my_sphere: Brep; same code as transformation

# ---- group: Visualize
# NOTES:
# 
# - Use Python 3 Script blocks for your functions.
# - Import your functions and classes as: from cdf import my_function, My_class
# - Don't forget to add and name your INPUT and OUTPUT parameters that match your functions correctly. If you zoom in to the Python component you will see the + sign to add and - to remove them.
# - You need to attach the accurate components to your INPUT parameters: sliders for integers or floats, toggles or buttons for booleans, text for strings, Rhino geometries etc. etc.
# - If an INPUT is  a list, you need to right-click the parameter to set it as LIST access. Sometimes you need to also set the type of the INPUT by clicking TYPE HINT and selecting the correct input type.
# - If you want to hide an object, right-click component and uncheck Preview. To visualize again, check Preview.
# - If you get errors, READ THEM! They often tell what's wrong in a simple language. If not, copy-paste to CoPilot and don't be afraid to play around!
# 
# For more Grasshopper Help, go to:
# https://developer.rhino3d.com/guides/scripting/scripting-component/#script-inputs-and-outputs
preview = CustomPreview(Geometry=cone.my_cone, Material=ColourSwatch(SwatchColor=RGB(255, 0, 51)))

preview_2 = CustomPreview(Geometry=boolean.result_geometry, Material=ColourSwatch(SwatchColor=RGB(255, 86, 255)))

preview_3 = CustomPreview(Geometry=transformation.my_spheres, Material=ColourSwatch(SwatchColor=RGB(14, 10, 89)))

preview_4 = CustomPreview(Geometry=box.my_box, Material=ColourSwatch(SwatchColor=RGB(255, 0, 69)))

preview_5 = CustomPreview(Geometry=transformation_2.my_spheres, Material=ColourSwatch(SwatchColor=RGB(255, 204, 64)))

preview_6 = CustomPreview(Geometry=sphere.my_sphere, Material=ColourSwatch(SwatchColor=RGB(255, 0, 51)))

# ----
transformation_3 = Python3Script(my_sphere=cone.my_cone, distance=Slider(4, range=1..10), count=Slider(4, range=1..10))  # -> out, my_spheres; inputs my_sphere: Brep; same code as transformation
py3 = Python3Script()  # -> out, a; unedited script template

# ---- group: Visualize
preview_7 = CustomPreview(Geometry=transformation_3.my_spheres, Material=ColourSwatch(SwatchColor=RGB(0, 0, 120)))

# ----
panel_2 = Panel(py3.a)
